# Grasshopper definition ExampleB.gh (Grasshopper 1.0.7)

number_slider = Slider(10, range=1..10)
length = GetNumber(Slider(40, range=11..40), AtLeast=1, AtMost=1, Maximum=1.797693135e+308, Minimum=-1.797693135e+308)
count = GetInteger(number_slider, AtLeast=1, AtMost=1, Maximum=2147483647, Minimum=-2147483648)
radius = GetNumber(Slider(0.5, range=0..1), AtLeast=1, AtMost=1, Maximum=1.797693135e+308, Minimum=-1.797693135e+308)
rectangle = Rectangle(Plane=PlaneXY(0, 0, 0), XSize=length, YSize=Domain(-2, 2), Radius=0)  # -> Rectangle, Length
series = Series(Start=count, Step=radius, Count=count)
multiplication = Multiplication(A=series, B=0.5)
pop2d = Populate2D(Region=rectangle.Rectangle, Count=count, Seed=1)
dom = ConstructDomain(DomainStart=radius, DomainEnd=Slider(10, range=0..10))
ma = MassAddition(Input=multiplication)  # -> Result, PartialResults
random = Random(Range=dom, Number=number_slider, Seed=2)
Z = UnitZ(Factor=random)
bbox = BoundingBox(Content=rectangle.Rectangle, Plane=PlaneXY(0, 0, 0))  # -> Box, Box_2
move = Move(Geometry=pop2d, Motion=Z)  # -> Geometry, Transform
line = LineSDL(Start=move.Geometry, Direction=Vector(0, 0, 1), Length=random)
cir = Circle(Plane=move.Geometry, Radius=ma.PartialResults)

# ---- group: RH_OUT:Line
crv = Curve(line)

# ---- group: RH_OUT:Curve
crv_2 = Curve(cir)

# ----
Z_2 = UnitZ(Factor=1)
extr = Extrude(Base=crv_2, Direction=Z_2)
cap = CapHoles(Brep=extr)

# ---- group: RH_OUT:Mesh
mesh = Mesh(cap)
